# Grasshopper definition GhAI_examples_noAPI.gh (Grasshopper 1.0.8)
# plug-ins: rhinoCopilot.Components

# ----
# 02_Rhino co-pilot
trigger = Trigger(Interval=-1000, TimerInterval=1000, Target=[get_viewport_image, model_to_json])

# ---- group: get obj+json
model_to_json = ModelToJSON()  # -> Status, Json_path
panel = Panel(model_to_json.Json_path)

# ---- group: get viewport
get_viewport_image = GetViewportImage()
panel_2 = Panel(get_viewport_image)
image_resource = ImageResource(get_viewport_image)

# ---- group: Render image
# 01_Render IA
# Luis Felipe Palomares
# luisfelipe.palomares@tec.mx
# Tec de Monterrey, campus Guadalajara
panel_3 = Panel("Using the provided image, generate a hyper realistic render of a building in an urban context. Keep the same camera position and image composition.")
render_viewport = RenderViewport(Prompt=panel_3, Run=Button())  # -> Status, ViewportImage, RenderedImage
image_resource_2 = ImageResource(render_viewport.RenderedImage)
image_resource_3 = ImageResource(render_viewport.ViewportImage)

# ---- group: data to json
# 03_GH co-pilot
panel_4 = Panel("""world coordinates
building dimensions
number of floors
total floor area
average area per floor
proposal building land use
average building height within 100m
amenities within a 10-minute walk""")
entwine = Entwine(FlattenInputs=True)
graft = GraftTree(Tree=panel_4, IncludeEmptyLists=True, IncludeNullItems=True)
panel_5 = Panel(entwine)

# ----
data_trees_to_json = DataTreesToJSONFile(Keys_tree=graft, Values_tree=entwine)  # -> Status, JSONPath

# ---- group: data to json (continued)
panel_6 = Panel(data_trees_to_json.Status)

# ----
gpt_model = ValueList({"4.1 Nano": "gpt-4.1-nano", "4.1 Mini": "gpt-4.1-mini", "4.1": "gpt-4.1", "5 Nano": "gpt-5-nano-2025-08-07", "5 Mini": "gpt-5-mini-2025-08-07", "5": "gpt-5-2025-08-07"}, selected="4.1 Nano")
panel_7 = Panel("""You are a spatial and architectural tutor. Analyze the Rhino viewport image and the corresponding 3D model data to provide spatial or design insights. Focus on space and its distribution of livable areas and less on actual coordinates. It is important to give insights about dimensions in meters and the relationship of spaces and spatial layout. Never mention source files (JSON or PNG). Never talk about the model, topology or geometry (vertices, polygon, meshes, faces), but instead about its architecture and spaces. Give historical references or case studies similar to this building being modeled. Take into account the colors, textures and materials being used.
For specific data, take the information from the json file exclusively.
Do not give final answers but guide through questions so that the end user learns about architecture. Give feedback.""")
api_key = Panel("")

llm_interface = LLMInterface(
    Api_key=api_key,
    Model=gpt_model,
    SystemPrompt=panel_7,
    User_prompt="describe el modelo",
    ImagePath=get_viewport_image,
    JSONPath=model_to_json.Json_path,
    Run_button=Button())

panel_8 = Panel(llm_interface)

gpt_model_2 = ValueList({"4.1 Nano": "gpt-4.1-nano", "4.1 Mini": "gpt-4.1-mini", "4.1": "gpt-4.1", "5 Nano": "gpt-5-nano-2025-08-07", "5 Mini": "gpt-5-mini-2025-08-07", "5": "gpt-5-2025-08-07"}, selected="4.1 Nano")
api_key_2 = Panel("")
panel_9 = Panel("""You are a spatial and architectural tutor. Analyze the Rhino viewport image and the corresponding 3D model data to provide spatial or design insights. Focus on space and its distribution of livable areas and less on actual coordinates. It is important to give insights about dimensions in meters and the relationship of spaces and spatial layout. Never mention source files (JSON or PNG). Never talk about the model, topology or geometry (vertices, polygon, meshes, faces), but instead about its architecture and spaces. Give historical references or case studies similar to this building being modeled. Take into account the colors, textures and materials being used.
For specific data, take the information from the json file exclusively.
Do not give final answers but guide through questions so that the end user learns about architecture. Give feedback.""")

llm_interface_2 = LLMInterface(
    Api_key=api_key_2,
    Model=gpt_model_2,
    SystemPrompt=panel_9,
    User_prompt="Describe el modelo",
    JSONPath=data_trees_to_json.JSONPath,
    Run_button=Button())

panel_10 = Panel(llm_interface_2)
